# Grasshopper definition p205.gh (Grasshopper 1.0.7)
# plug-ins: Kangaroo2 Components

number_slider = Slider(8, range=0..10)
number_slider_2 = Slider(8, range=0..10)
ghpython_script = GhPythonScript()  # -> Out, A
center_box = CenterBox(Base=PlaneXY(0, 0, 0), X=number_slider, Y=number_slider, Z=number_slider)
box_array = BoxArray(Geometry=center_box, Cell=center_box, XCount=number_slider_2, YCount=number_slider_2, ZCount=number_slider_2)  # -> Geometry, Transform
solid_union = SolidUnion(Breps=box_array.Geometry)
populate_geometry = PopulateGeometry(Geometry=solid_union, Count=Slider(6, range=0..10), Seed=Slider(35, range=0..100))
sphere = Sphere(Base=populate_geometry, Radius=Slider(43, range=0..100))
brep = Brep(solid_union)
geometry = Geometry(box_array.Geometry)
volume = Volume(Geometry=geometry)  # -> Volume, Centroid
solid_difference = SolidDifference(BrepsA=brep, BrepsB=sphere)
point_in_brep = PointInBrep(Brep=solid_difference, Point=volume.Centroid, Strict=False)
cull_pattern = CullPattern(List=geometry, CullPattern=point_in_brep)
brep_wireframe = BrepWireframe(Brep=cull_pattern, Density=-1)
removeduplicatelines = RemoveDuplicateLines(Lines=flatten(brep_wireframe), Tolerance=0.01)
pipe = Pipe(Curve=removeduplicatelines, Radius=Slider(0.7, range=0..1), Caps=Slider(2, range=0..10))
custom_preview = CustomPreview(Geometry=pipe, Material=ColourSwatch(SwatchColor=RGB(255, 255, 255)))
